# Grasshopper definition Examples.gh (Grasshopper 1.0.7)
# Copyright: Werner Sobek AG
# plug-ins: SOFiSTiK CDB Access

# ----
# Input
# Define the CDB_Path and
# switch toggle to true
toggle = BooleanToggle(False)
cdb_path = FilePath()
first_group = Panel("1")
last_group = Panel("10")
load_cases = Panel("""1
2""")

# ----
# Start SOFiSTiK
button = Button()
startsofistik2020 = StartSOFiSTiK2020(
    CDBPath=cdb_path,
    StartSSD=False,
    StartAnimator=button,
    StartWinGRAF=Button(),
    StartResultViewer=False,
    StartTeddy=False,
    StartWPS=False,
    StartExport=False,
    RunModel=False,
    SilentMode=False)

# ----
# Info
getinfo = GetInfo(TrueFalse=toggle, CDBPath=cdb_path, DLLFolder="C:\Program Files\SOFiSTiK\2020\SOFiSTiK 2020\interfaces\64bit")  # -> LoadCases, GroupNumbers, FirstElementNumber, LastElementNumber

# ----
# General
getsupportforces = GetSupportForces(
    TrueFalse=toggle,
    CDBPath=cdb_path,
    GlobalOrLocalCoordinates="Global",
    LoadCases=load_cases,
    DLLFolder="C:\Program Files\SOFiSTiK\2020\SOFiSTiK 2020\interfaces\64bit")  # -> NodesNumber, Nodes3DPoint, LocalCoordinates, PxSupportForces, PySupportForces, PzSupportForces, MxSupportMoments, MySupportMoments, MzSupportMoments
getdisplacement = GetDisplacement(
    TrueFalse=toggle,
    CDBPath=cdb_path,
    FirstSOFiSTiKGroups=first_group,
    LastSOFiSTiKGroups=last_group,
    LoadCases=load_cases,
    DLLFolder="C:\Program Files\SOFiSTiK\2020\SOFiSTiK 2020\interfaces\64bit")  # -> NodesNumber, Nodes3DPoint, XDispalcement, YDispalcement, ZDispalcement, XRotation, YRotation, ZRotation
getnodalloads = GetNodalLoads(
    TrueFalse=toggle,
    CDBPath=cdb_path,
    LoadCases=load_cases,
    DLLFolder="C:\Program Files\SOFiSTiK\2020\SOFiSTiK 2020\interfaces\64bit")  # -> NodesNumber, Nodes3DPoint, FLoad, MLoad

# ----
# Beams
groups = Panel("""1
2""")
pt = Point(<point referenced from the Rhino model>)
connectionforces = ConnectionForces(
    TrueFalse=toggle,
    CDBPath=cdb_path,
    SOFiSTiKGroups=groups,
    LoadCases=load_cases,
    PointAtTheNode=pt,
    DLLFolder="C:\Program Files\SOFiSTiK\2020\SOFiSTiK 2020\interfaces\64bit")  # -> BeamElement, YDirection, AdjacentPoint, BeamNumber, FAtNode_kN, MAtNode_kN, FAdjacentNode_kN, MAdjacentNode_kN, AddLoadF_kN, AddLoadM_kN
getbeamnodes = GetBeamNodes(
    TrueFalse=toggle,
    CDBPath=cdb_path,
    FirstSOFiSTiKGroups=first_group,
    LastSOFiSTiKGroups=last_group,
    DLLFolder="C:\Program Files\SOFiSTiK\2020\SOFiSTiK 2020\interfaces\64bit")  # -> BeamNumber, BeamNode1, BeamNode2, Node13DPoint, Node23DPoint, CrossSectionNode1, CrossSectionNode2, LocalCoordinates
getbeamforces = GetBeamForces(
    TrueFalse=toggle,
    CDBPath=cdb_path,
    FirstSOFiSTiKGroups=first_group,
    LastSOFiSTiKGroups=last_group,
    LoadCases=load_cases,
    DLLFolder="C:\Program Files\SOFiSTiK\2020\SOFiSTiK 2020\interfaces\64bit")  # -> BeamNumber, LengthOfTheBeam, NormalForcesNode1_kN, ShearForcesVyNode1_kN, ShearForcesVzNode1_kN, TorsionalMomentMtNode1_kNm, BendingMomentMyNode1_kNm, BendingMomentMzNode1_kNm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
ln = Line(StartPoint=getbeamnodes.Node13DPoint, EndPoint=getbeamnodes.Node23DPoint)

# ----
# QUADs
getquadnodes = GetQUADNodes(
    TrueFalse=toggle,
    CDBPath=cdb_path,
    FirstSOFiSTiKGroups=first_group,
    LastSOFiSTiKGroups=last_group,
    DLLFolder="C:\Program Files\SOFiSTiK\2020\SOFiSTiK 2020\interfaces\64bit")  # -> QuadNumber, QuadNode1, QuadNode2, QuadNode3, QuadNode4, Node13DPoint, Node23DPoint, Node33DPoint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
getquadforces = GetQUADForces(
    TrueFalse=toggle,
    CDBPath=cdb_path,
    FirstSOFiSTiKGroups=first_group,
    LastSOFiSTiKGroups=last_group,
    LoadCases=load_cases,
    DLLFolder="C:\Program Files\SOFiSTiK\2020\SOFiSTiK 2020\interfaces\64bit")  # -> QUADNumber, BendingMomentMxx, BendingMomentMyy, BendingMomentMxy, ShearForceVx, ShearForceVy, MembraneForceNxx, MembraneForceNyy, MembraneForceNxy
srf4pt = _4PointSurface(
    CornerA=getquadnodes.Node13DPoint,
    CornerB=getquadnodes.Node23DPoint,
    CornerC=getquadnodes.Node33DPoint,
    CornerD=getquadnodes.Node43DPoint)
